# Dynamo graph DynamoBasics_05.dyn (Dynamo 2.12.0.5650)

# group: All elements of Cat
# note: Working / Functions
# Green indicates the working of the script. No changes should be made in these groups unless advised.
# note: Variables / Inputs
# Red indicates Variables that can be altered per project and must be set accordingly before running the script.
categories = Categories()  # nothing selected
all_elements_of_category = ElementsOfCategory(Category=categories)
# note: Checking / Outputs
# Orange indicates checking nodes to ensure the script has deployed correctly.
# note: Important stuff
# Purple will indicate something important is going on here.
# note: DesignScript
code_block = CodeBlock { cat = Category.ByName("Walls"); ElementQueries.OfCategory(cat); }

code_block_2 = CodeBlock(x=code_block.out1) { x[0]; }

# group: Instance Param
parameters = Element.Parameters(element=code_block_2)

# group: Type Parameters
elementType = Element.ElementType(element=code_block_2)
parameters_2 = Element.Parameters(element=elementType)

code_block_3 = CodeBlock(e=code_block_2)
# ---------- code_block_3.designscript (5 lines) ----------
type_e = Elements.Element.ElementType(e);

ID = e.Id;
instance_parameters = e.Parameters;
type_parameters = type_e.Parameters;
# ----------------------------------------

# group: Element ID
id = Element.Id(element=code_block_2)

getParameterValueByName = Element.GetParameterValueByName(element=code_block.out1)  # unwired: parameterName
